# Grasshopper definition test.gh (Grasshopper 1.0.7)
# plug-ins: BH.UI.Grasshopper

# point_radius:[longitude latitude radius]
panel = Panel("point_radius:[-105.27346517 40.01924738 10.0mi]")
panel_2 = Panel("latitude,longitude,radius")
# Add "-RT" to search to eliminate retweets
panel_3 = Panel("53.408331,-2.991637,100.0km")

# ----
# Premium Query SUBSCRIPTION
# Apply for access: https://developer.twitter.com/en/apply-for-access
# https://api.twitter.com/1.1/tweets/search/fullarchive/production.json
# QUERY BUILDING SEE:
# https://developer.twitter.com/en/docs/tweets/rules-and-filtering/guides/using-premium-operators
# PREMIUM PARAMETER descriptions:
# https://developer.twitter.com/en/docs/tweets/search/api-reference/premium-search#DataEndpoint
panel_4 = Panel("https://api.twitter.com/1.1/tweets/search/fullarchive/full.json")
panel_5 = Panel("-is:retweet Liverpool Anfield lang:en point_radius:[-2.991637 53.408331 40km]")
credentials = Credentials(Component="BH.oM.Twitter.Credentials")
premiumsearchparameters = PremiumSearchParameters(Query=panel_5, MaxResults=Slider(10, range=0..10), Component="BH.oM.Twitter.PremiumSearchParameters")
authenticateapplication = AuthenticateApplication(Credentials=credentials, Component="{ .AuthenticateApplication")
searchtweets = SearchTweets(
    Application=authenticateapplication,
    Endpoint=panel_4,
    SearchParameters=premiumsearchparameters,
    Component="{ .SearchTweets")
explode = Explode(Object=searchtweets, Component="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")  # -> Results, BHoM_Guid, Name, Fragments, Tags, CustomData
explode_2 = Explode(Object=explode.Results, Component="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")  # -> Objects, Name, Tags, BHoM_Guid
explode_3 = Explode(Object=explode_2.Objects, Component="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")  # -> Created_at, Id, Id_str, Text, Source, Truncated, In_reply_to_status_id, In_reply_to_status_id_str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

panel_6 = Panel(explode_3.Text)

# ----
# Standard Query FREE
# Apply for access: https://developer.twitter.com/en/apply-for-access
# STANDARD QUERY BUILDING SEE:
# https://developer.twitter.com/en/docs/tweets/search/guides/standard-operators
# STANDARD PARAMETER descriptions:
# https://developer.twitter.com/en/docs/tweets/search/api-reference/get-search-tweets
panel_7 = Panel("-RT Anfield")
credentials_2 = Credentials(Component="BH.oM.Twitter.Credentials")
standardsearchparameters = StandardSearchParameters(
    Query=panel_7,
    Geocode=panel_3,
    Lang="en",
    Count=Slider(100, range=0..100),
    IncludeEntities=True,
    Component="BH.oM.Twitter.StandardSearchParameters")
authenticateapplication_2 = AuthenticateApplication(Credentials=credentials_2, Component="{ .AuthenticateApplication")
searchtweets_2 = SearchTweets(Application=authenticateapplication_2, SearchParameters=standardsearchparameters, Component="{ .SearchTweets")
explode_4 = Explode(Object=searchtweets_2, Component="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")  # -> Results, BHoM_Guid, Name, Fragments, Tags, CustomData

explode_5 = Explode(Object=explode_4.Results, Component="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")  # -> Objects, Name, Tags, BHoM_Guid

explode_6 = Explode(Object=explode_5.Objects, Component="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")  # -> Created_at, Id, Id_str, Text, Truncated, Entities, Metadata, Source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

panel_8 = Panel(explode_6.Text)
